# Grasshopper definition grasshopper_revised.gh (Grasshopper 1.0.8)
# plug-ins: MeshEdit Components, gHowl

udp = UDPReceiver(Port=Slider(9001, range=0..10000), Pattern=0)  # -> Info, Data
panel = Panel(udp.Data)
split = TextSplit(Text=udp.Data, Separators=",")
sqgrid = Square(
    Plane=PlaneXY(0, 0, 0),
    Size=Slider(30, range=0..100),
    ExtentX=Slider(119, range=0..200),
    ExtentY=Slider(59, range=0..100))  # -> Cells, flatten(Points)
num = Number(split)
pt = Point(sqgrid.Points)
multiplication = Multiplication(A=num, B=Slider(60, range=0..100))
Z = UnitZ(Factor=1)
amp = Amplitude(Vector=Z, Amplitude=multiplication)
panel_2 = Panel(amp)
Z_2 = UnitZ(Factor=amp)
move = Move(Geometry=pt, Motion=Z_2)  # -> Geometry, Transform
pt_2 = Point(move.Geometry)
frompoints = MeshFromPoints(Points=pt_2, UDirection=Slider(120, range=0..200), VDirection=Slider(60, range=0..100))
avr = Average(Input=num)
